# Grasshopper definition Kikayon_1.4.gh (Grasshopper 1.0.7)
# plug-ins: LadybugGrasshopper

# ----
# General Properties
street_orientation_deg = Slider(0, range=0..360)
street_length_m = Slider(200, range=100..1000)
sidewalk_height_m = Slider(0.2, range=0..1)

# ----
# Radiation Analysis
# Properties
analysis_resolution_m = Slider(1, range=1..10)
true_turn_analysis_on = LBFalseStartToggle(False)
start_date_number = Slider(6, range=1..31)
start_month_number = Slider(8, range=1..12)
end_month_number = Slider(8, range=1..12)
end_date_number = Slider(6, range=1..31)
start_hour = Slider(7, range=0..23)
# Street Dimensions
end_hour = Slider(16, range=0..23)

# ----
# 3D Display
true_on = BooleanToggle(True)

# ----
# Section Selector
section_number = Slider(6, range=0..20)

# ----
# Text Properties
number_slider = Slider(75, range=-100..200)
y_coordinate = Slider(160, range=-100..200)
font_size = Slider(7, range=0..20)

# ----
# First row
tree_type = ValueList({"Delonix regia [5 years]": 0, "Delonix regia [10 years]": 1, "Delonix regia [mature]": 2, "Celtis Bungea [5 years]": 3, "Celtis Bungea [10 years]": 4, "Celtis Bungea [mature]": 5, "Fraxinus Uhdei Var Obelisk [5 years]": 6, "Fraxinus Uhdei Var Obelisk [10 years]": 7, "Fraxinus Uhdei Var Obelisk [mature]": 8}, selected="Delonix regia [5 years]")
tree_type_2 = ValueList({"Delonix regia [5 years]": 0, "Delonix regia [10 years]": 1, "Delonix regia [mature]": 2, "Celtis Bungea [5 years]": 3, "Celtis Bungea [10 years]": 4, "Celtis Bungea [mature]": 5, "Fraxinus Uhdei Var Obelisk [5 years]": 6, "Fraxinus Uhdei Var Obelisk [10 years]": 7, "Fraxinus Uhdei Var Obelisk [mature]": 8}, selected="Delonix regia [5 years]")
tree_type_3 = ValueList({"Delonix regia [5 years]": 0, "Delonix regia [10 years]": 1, "Delonix regia [mature]": 2, "Celtis Bungea [5 years]": 3, "Celtis Bungea [10 years]": 4, "Celtis Bungea [mature]": 5, "Fraxinus Uhdei Var Obelisk [5 years]": 6, "Fraxinus Uhdei Var Obelisk [10 years]": 7, "Fraxinus Uhdei Var Obelisk [mature]": 8}, selected="Delonix regia [10 years]")

# ---- group: Double Click to set tree configuration
# Tree Type Configuration
tree_picker = TreePicker(G=0)  # -> f_l, R, Z, R_2

# ----
tree_type_4 = ValueList({"Delonix regia [5 years]": 0, "Delonix regia [10 years]": 1, "Delonix regia [mature]": 2, "Celtis Bungea [5 years]": 3, "Celtis Bungea [10 years]": 4, "Celtis Bungea [mature]": 5, "Fraxinus Uhdei Var Obelisk [5 years]": 6, "Fraxinus Uhdei Var Obelisk [10 years]": 7, "Fraxinus Uhdei Var Obelisk [mature]": 8}, selected="Delonix regia [5 years]")
tree_type_5 = ValueList({"Delonix regia [5 years]": 0, "Delonix regia [10 years]": 1, "Delonix regia [mature]": 2, "Celtis Bungea [5 years]": 3, "Celtis Bungea [10 years]": 4, "Celtis Bungea [mature]": 5, "Fraxinus Uhdei Var Obelisk [5 years]": 6, "Fraxinus Uhdei Var Obelisk [10 years]": 7, "Fraxinus Uhdei Var Obelisk [mature]": 8}, selected="Fraxinus Uhdei Var Obelisk [mature]")

# ----
# Horizontal Awning
# Side 1
# Side 2
height_from_ground_m = Slider(0, range=0..50)
depth = Slider(0, range=0..50)
height_from_ground_m_2 = Slider(0, range=0..50)
depth_2 = Slider(0, range=0..50)

panel = Panel("Part 4: Climatic analysis")
analysis_resolution = Panel(analysis_resolution_m)
panel_2 = Panel("Ground level")

swatch = ColourSwatch(SwatchColor=RGBA(130, 171, 120, 44))

filter = StreamFilter(Gate=true_on, Stream1=ColourSwatch(SwatchColor=RGB(104, 150, 92)))

compass = LBCompass(north=street_orientation_deg, center="0,-25", scale="1")  # -> compass; plug-in component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

# ----
# Reference Surface
panel_3 = Panel("-75")
panel_4 = Panel(analysis_resolution)
pt = ConstructPoint(XCoordinate="80", YCoordinate=panel_3, ZCoordinate=0)
planesrf = PlaneSurface(Plane=pt, XSize=panel_4, YSize=panel_4)

hourly_target_shade_availability_ratio = Slider(0.5, range=0..1)
panel_5 = Panel("Typical level")

# ----
# Side Tags
panel_6 = Panel("10")
tag = TextTag3D(Location="40,-20", Text="2", Size=panel_6, Colour="0,0,0", Justification=7)
tag_2 = TextTag3D(Location="-50,-20", Text="1", Size="10", Colour="0,0,0", Justification=7)

# ----
# Road
parking_strip_width_side_1_m = Slider(0, range=0..20)
traffic_strip_width_m = Slider(15, range=0..30)
parking_strip_width_side_2_m = Slider(0, range=0..20)
central_boulevard_width_m = Slider(15, range=0..30)

expression = Expression(x=central_boulevard_width_m, Expression="x=0")
filter_2 = StreamFilter(Gate=expression, Stream0=font_size, Stream1="0")

# ----
# Sidewalk 1
walking_strip_width_m = Slider(3, range=0..20)
street_furniture_strip_width_m = Slider(0, range=0..20)
planting_strip_width_m = Slider(1.2, range=0..20)
bicycle_lane_width_m = Slider(2.3, range=0..20)

street_furniture_strip_width_m_2 = Slider(0, range=0..20)
bicycle_lane_width_m_2 = Slider(2.3, range=0..20)
# Building Dimensions and Locations
planting_strip_width_m_2 = Slider(1.2, range=0..20)
# Sidewalk 2
walking_strip_width_m_2 = Slider(3, range=0..20)

# ----
# Side 1 Buildings
# OR
number_of_buildings = Slider(3, range=1..20)
front_building_line_m = Slider(3, range=0..30)
number_of_typical_floors = Slider(6, range=0..100)
front_setback_of_a_typical_floor_m = Slider(3, range=-50..50)
building_depth_m = Slider(22, range=10..75)
lateral_building_line_m = Slider(16, range=0..50)
typical_floor_height_m = Slider(5, range=0..20)
lateral_setback_of_a_typical_floor_m = Slider(0, range=-25..25)
entrance_level_height_m = Slider(3, range=0..20)
front_setback_of_roof_level_m = Slider(-3, range=-20..20)
roof_level_height_m = Slider(3, range=0..100)
lateral_setback_of_roof_level_m = Slider(-3, range=-30..30)
use_external_model = LBFalseStartToggle(False)
building_geometry_side_1_from_external_m = Brep(<brep referenced from the Rhino model>)  # "Building Geometry Side 1 from external model"
front_building_line_m_2 = Slider(3, range=0..30)

# ----
# Side 2 Buildings
# OR
number_of_buildings_2 = Slider(1, range=1..20)
front_building_line_m_3 = Slider(3, range=0..30)
building_depth_m_2 = Slider(22, range=10..75)
lateral_building_line_m_2 = Slider(10, range=0..20)
typical_floor_height_m_2 = Slider(3, range=0..20)
use_external_model_2 = LBFalseStartToggle(False)
entrance_level_height_m_2 = Slider(3, range=0..20)
number_of_typical_floors_2 = Slider(3, range=0..100)
roof_level_height_m_2 = Slider(3, range=0..100)
front_setback_of_a_typical_floor_m_2 = Slider(-3, range=-50..50)
lateral_setback_of_a_typical_floor_m_2 = Slider(0, range=-25..25)
building_geometry_side_2_from_external_m = Brep(<brep referenced from the Rhino model>)  # "Building Geometry Side 2 from external model"
front_setback_of_roof_level_m_2 = Slider(3, range=-20..20)
lateral_setback_of_roof_level_m_2 = Slider(3, range=-30..30)
front_building_line_m_4 = Slider(3, range=0..30)

division = Division(A=traffic_strip_width_m, B=2)
division_2 = Division(A=central_boulevard_width_m, B=2)
addition = Addition(A=division, B=division_2)
pt_2 = ConstructPoint(XCoordinate=0, YCoordinate=street_length_m, ZCoordinate=0)
pt_3 = ConstructPoint(XCoordinate=0, YCoordinate=0, ZCoordinate=0)
ma = MassAddition(Input=[street_furniture_strip_width_m_2, walking_strip_width_m_2, bicycle_lane_width_m_2, planting_strip_width_m_2])  # -> Result, PartialResults
ma_2 = MassAddition(Input=[street_furniture_strip_width_m, walking_strip_width_m, bicycle_lane_width_m, planting_strip_width_m])  # -> Result, PartialResults
ln = Line(StartPoint=pt_2, EndPoint=pt_3)
join = TextJoin(Text=[ma.Result, " Meter"])
join_2 = TextJoin(Text=[ma_2.Result, " Meter"])
addition_2 = Addition(A=addition, B=parking_strip_width_side_1_m)
addition_3 = Addition(A=addition, B=parking_strip_width_side_2_m)
neg = Negative(Value=addition_3)
offset = OffsetCurve(Curve=ln, Distance=[neg, addition_2], Plane=PlaneXY(0, 0, 0), Corners=1)  # -> flatten(Curve)
graft = GraftTree(Tree=offset, IncludeEmptyLists=True, IncludeNullItems=True)
Z = UnitZ(Factor=sidewalk_height_m)
move = Move(Geometry=offset, Motion=Z)  # -> Geometry, Transform
bang = ExplodeTree(Data=graft(move.Geometry))  # -> Branch0, Branch1
neg_2 = Negative(Value=ma.Result)
graft_2 = GraftTree(Tree=move.Geometry, IncludeEmptyLists=True, IncludeNullItems=True)
graft_3 = GraftTree(Tree=move.Geometry, IncludeEmptyLists=True, IncludeNullItems=True)
offset_2 = OffsetCurve(Curve=move.Geometry, Distance=[neg_2, ma_2.Result], Plane=PlaneXY(0, 0, 0), Corners=1)
divide = DivideCurve(Curve=offset_2, Count=number_of_buildings, Kinks=False)  # -> Points, Tangents, Parameters
divide_2 = DivideCurve(Curve=offset_2, Count=number_of_buildings_2, Kinks=False)  # -> Points, Tangents, Parameters
bang_2 = ExplodeTree(Data=offset_2)  # -> Branch0, Branch1
shatter = Shatter(Curve=bang_2.Branch1, Parameters=divide.Parameters)
shatter_2 = Shatter(Curve=bang_2.Branch0, Parameters=divide_2.Parameters)

resulting_sidewalk_2_width = Panel(join)

resulting_sidewalk_1_width = Panel(join_2)

multiplication = Multiplication(A=lateral_building_line_m_2, B=2)
addition_4 = Addition(A=building_depth_m_2, B=multiplication)
graft_4 = GraftTree(Tree=shatter_2, IncludeEmptyLists=True, IncludeNullItems=True)
X = UnitX(Factor=addition_4)
move_2 = Move(Geometry=shatter_2, Motion=X)  # -> Geometry, Transform
graft_5 = GraftTree(Tree=move_2.Geometry, IncludeEmptyLists=True, IncludeNullItems=True)
loft = Loft(
    Curves=[graft_5, graft_4],
    Options={Adjust=False, Closed=False, LoftEnds=0, LoftSimp=0, LoftType=0, Rebuild=10, Refit=0.01})
debrep = DeconstructBrep(Brep=loft)  # -> Faces, Edges, Vertices
division_3 = Division(A=multiplication, B=2)
join_3 = JoinCurves(Curves=debrep.Edges, Preserve=False)
neg_3 = Negative(Value=division_3)
offset_3 = OffsetCurve(Curve=join_3, Distance=neg_3, Plane=PlaneXY(0, 0, 0), Corners=1)
X_2 = UnitX(Factor=neg_3)
move_3 = Move(Geometry=offset_3, Motion=X_2)  # -> Geometry, Transform
X_3 = UnitX(Factor=front_building_line_m_3)
move_4 = Move(Geometry=move_3.Geometry, Motion=X_3)  # -> Geometry, Transform
Z_2 = UnitZ(Factor=entrance_level_height_m_2)
boxrec = BoxRectangle(Rectangle=move_4.Geometry, Height=Z_2)
# Pick face as floor base
number_slider_2 = Slider(5, range=0..20)
debrep_2 = DeconstructBrep(Brep=boxrec)  # -> Faces, Edges, Vertices
item = ListItem(List=debrep_2.Faces, Index=number_slider_2, Wrap=True)
debrep_3 = DeconstructBrep(Brep=item)  # -> Faces, Edges, Vertices
item_2 = ListItem(List=debrep_3.Edges, Index=Slider(0, range=0..3), Wrap=True)
item_3 = ListItem(List=debrep_3.Edges, Index=Slider(2, range=0..3), Wrap=True)
neg_4 = Negative(Value=lateral_setback_of_a_typical_floor_m_2)
Y = UnitY(Factor=neg_4)
Y_2 = UnitY(Factor=lateral_setback_of_a_typical_floor_m_2)
move_5 = Move(Geometry=item_2, Motion=Y)  # -> Geometry, Transform
move_6 = Move(Geometry=item_3, Motion=Y_2)  # -> Geometry, Transform
flip = FlipCurve(Curve=move_5.Geometry)  # -> Curve, Flag
end = EndPoints(Curve=move_6.Geometry)  # -> Start, End
end_2 = EndPoints(Curve=flip.Curve)  # -> Start, End
X_4 = UnitX(Factor=front_setback_of_a_typical_floor_m_2)
move_7 = Move(Geometry=end.Start, Motion=X_4)  # -> Geometry, Transform
move_8 = Move(Geometry=end_2.Start, Motion=X_4)  # -> Geometry, Transform
ln_2 = Line(StartPoint=end_2.End, EndPoint=move_8.Geometry)
ln_3 = Line(StartPoint=end.End, EndPoint=move_7.Geometry)
multiplication_2 = Multiplication(A=typical_floor_height_m_2, B=number_of_typical_floors_2)
loft_2 = Loft(Curves=[ln_3, ln_2], Options={Adjust=False, Closed=False, LoftEnds=0, LoftSimp=0, LoftType=0, Rebuild=10, Refit=0.01})
Z_3 = UnitZ(Factor=multiplication_2)
extr = Extrude(Base=loft_2, Direction=Z_3)
debrep_4 = DeconstructBrep(Brep=extr)  # -> Faces, Edges, Vertices
item_4 = ListItem(List=debrep_4.Faces, Index=Slider(5, range=0..6), Wrap=True)
debrep_5 = DeconstructBrep(Brep=item_4)  # -> Faces, Edges, Vertices
item_5 = ListItem(List=debrep_5.Edges, Index=Slider(1, range=0..3), Wrap=True)
item_6 = ListItem(List=debrep_5.Edges, Index=Slider(3, range=0..3), Wrap=True)
neg_5 = Negative(Value=lateral_setback_of_roof_level_m_2)
Y_3 = UnitY(Factor=neg_5)
Y_4 = UnitY(Factor=lateral_setback_of_roof_level_m_2)
move_9 = Move(Geometry=item_5, Motion=Y_3)  # -> Geometry, Transform
move_10 = Move(Geometry=item_6, Motion=Y_4)  # -> Geometry, Transform
flip_2 = FlipCurve(Curve=move_9.Geometry)  # -> Curve, Flag
end_3 = EndPoints(Curve=move_10.Geometry)  # -> Start, End
end_4 = EndPoints(Curve=flip_2.Curve)  # -> Start, End
X_5 = UnitX(Factor=front_setback_of_roof_level_m_2)
move_11 = Move(Geometry=end_3.Start, Motion=X_5)  # -> Geometry, Transform
move_12 = Move(Geometry=end_4.Start, Motion=X_5)  # -> Geometry, Transform
ln_4 = Line(StartPoint=end_4.End, EndPoint=move_12.Geometry)
ln_5 = Line(StartPoint=end_3.End, EndPoint=move_11.Geometry)
loft_3 = Loft(Curves=[ln_5, ln_4], Options={Adjust=False, Closed=False, LoftEnds=0, LoftSimp=0, LoftType=0, Rebuild=10, Refit=0.01})
Z_4 = UnitZ(Factor=roof_level_height_m_2)
panel_7 = Panel("Top level")
extr_2 = Extrude(Base=loft_3, Direction=Z_4)

bbox = BoundingBox(Content=building_geometry_side_1_from_external_m, Plane=PlaneXY(0, 0, 0))  # -> Box, Box_2
box_corners = BoxCorners(Box=bbox.Box_2)  # -> CornerA, CornerB, CornerC, CornerD, CornerE, CornerF, CornerG, CornerH
sidewalk_1_boundary = Line(bang_2.Branch1)
ln_6 = Line(StartPoint=box_corners.CornerB, EndPoint=box_corners.CornerC)
midpt = CurveMiddle(Curve=sidewalk_1_boundary)
midpt_2 = CurveMiddle(Curve=ln_6)
panel_8 = Panel(midpt)
vec2pt = Vector2Pt(PointA=midpt_2, PointB=panel_8, Unitize=False)  # -> Vector, Length
move_13 = Move(Geometry=building_geometry_side_1_from_external_m, Motion=vec2pt.Vector)  # -> Geometry, Transform
neg_6 = Negative(Value=front_building_line_m_2)
X_6 = UnitX(Factor=neg_6)
move_14 = Move(Geometry=move_13.Geometry, Motion=X_6)  # -> Geometry, Transform
brep_side_1_external_model = Brep(move_14.Geometry)

# ----
# Pick face as floor base
multiplication_3 = Multiplication(A=lateral_building_line_m, B=2)
addition_5 = Addition(A=building_depth_m, B=multiplication_3)
graft_6 = GraftTree(Tree=shatter, IncludeEmptyLists=True, IncludeNullItems=True)
neg_7 = Negative(Value=addition_5)
X_7 = UnitX(Factor=neg_7)
move_15 = Move(Geometry=shatter, Motion=X_7)  # -> Geometry, Transform
graft_7 = GraftTree(Tree=move_15.Geometry, IncludeEmptyLists=True, IncludeNullItems=True)
loft_4 = Loft(
    Curves=[graft_7, graft_6],
    Options={Adjust=False, Closed=False, LoftEnds=0, LoftSimp=0, LoftType=0, Rebuild=10, Refit=0.01})
debrep_6 = DeconstructBrep(Brep=loft_4)  # -> Faces, Edges, Vertices
division_4 = Division(A=multiplication_3, B=2)
join_4 = JoinCurves(Curves=debrep_6.Edges, Preserve=False)
offset_4 = OffsetCurve(Curve=join_4, Distance=division_4, Plane=PlaneXY(0, 0, 0), Corners=1)
X_8 = UnitX(Factor=division_4)
move_16 = Move(Geometry=offset_4, Motion=X_8)  # -> Geometry, Transform
neg_8 = Negative(Value=front_building_line_m)
X_9 = UnitX(Factor=neg_8)
move_17 = Move(Geometry=move_16.Geometry, Motion=X_9)  # -> Geometry, Transform
Z_5 = UnitZ(Factor=entrance_level_height_m)
flip_3 = FlipCurve(Curve=move_17.Geometry)  # -> Curve, Flag
boxrec_2 = BoxRectangle(Rectangle=flip_3.Curve, Height=Z_5)
debrep_7 = DeconstructBrep(Brep=boxrec_2)  # -> Faces, Edges, Vertices
item_7 = ListItem(List=debrep_7.Faces, Index=Slider(5, range=0..20), Wrap=True)
debrep_8 = DeconstructBrep(Brep=item_7)  # -> Faces, Edges, Vertices
item_8 = ListItem(List=debrep_8.Edges, Index=Slider(1, range=0..3), Wrap=True)
item_9 = ListItem(List=debrep_8.Edges, Index=Slider(3, range=0..3), Wrap=True)
neg_9 = Negative(Value=lateral_setback_of_a_typical_floor_m)
Y_5 = UnitY(Factor=neg_9)
Y_6 = UnitY(Factor=lateral_setback_of_a_typical_floor_m)
move_18 = Move(Geometry=item_8, Motion=Y_5)  # -> Geometry, Transform
move_19 = Move(Geometry=item_9, Motion=Y_6)  # -> Geometry, Transform
flip_4 = FlipCurve(Curve=move_18.Geometry)  # -> Curve, Flag
end_5 = EndPoints(Curve=move_19.Geometry)  # -> Start, End
end_6 = EndPoints(Curve=flip_4.Curve)  # -> Start, End
X_10 = UnitX(Factor=front_setback_of_a_typical_floor_m)
move_20 = Move(Geometry=end_5.Start, Motion=X_10)  # -> Geometry, Transform
move_21 = Move(Geometry=end_6.Start, Motion=X_10)  # -> Geometry, Transform
ln_7 = Line(StartPoint=end_6.End, EndPoint=move_21.Geometry)
ln_8 = Line(StartPoint=end_5.End, EndPoint=move_20.Geometry)
multiplication_4 = Multiplication(A=typical_floor_height_m, B=number_of_typical_floors)
loft_5 = Loft(Curves=[ln_8, ln_7], Options={Adjust=False, Closed=False, LoftEnds=0, LoftSimp=0, LoftType=0, Rebuild=10, Refit=0.01})
Z_6 = UnitZ(Factor=multiplication_4)
extr_3 = Extrude(Base=loft_5, Direction=Z_6)
debrep_9 = DeconstructBrep(Brep=extr_3)  # -> Faces, Edges, Vertices
item_10 = ListItem(List=debrep_9.Faces, Index=Slider(5, range=0..6), Wrap=True)
debrep_10 = DeconstructBrep(Brep=item_10)  # -> Faces, Edges, Vertices
item_11 = ListItem(List=debrep_10.Edges, Index=Slider(1, range=0..3), Wrap=True)
item_12 = ListItem(List=debrep_10.Edges, Index=Slider(3, range=0..3), Wrap=True)
neg_10 = Negative(Value=lateral_setback_of_roof_level_m)
Y_7 = UnitY(Factor=neg_10)
Y_8 = UnitY(Factor=lateral_setback_of_roof_level_m)
move_22 = Move(Geometry=item_11, Motion=Y_7)  # -> Geometry, Transform
move_23 = Move(Geometry=item_12, Motion=Y_8)  # -> Geometry, Transform
flip_5 = FlipCurve(Curve=move_22.Geometry)  # -> Curve, Flag
end_7 = EndPoints(Curve=move_23.Geometry)  # -> Start, End
end_8 = EndPoints(Curve=flip_5.Curve)  # -> Start, End
X_11 = UnitX(Factor=front_setback_of_roof_level_m)
move_24 = Move(Geometry=end_7.Start, Motion=X_11)  # -> Geometry, Transform
move_25 = Move(Geometry=end_8.Start, Motion=X_11)  # -> Geometry, Transform
ln_9 = Line(StartPoint=end_8.End, EndPoint=move_25.Geometry)
ln_10 = Line(StartPoint=end_7.End, EndPoint=move_24.Geometry)
loft_6 = Loft(Curves=[ln_10, ln_9], Options={Adjust=False, Closed=False, LoftEnds=0, LoftSimp=0, LoftType=0, Rebuild=10, Refit=0.01})
Z_7 = UnitZ(Factor=roof_level_height_m)
extr_4 = Extrude(Base=loft_6, Direction=Z_7)

# ---- group: Street facade length
len = Length(Curve=shatter)  # -> flatten(Length)
item_13 = ListItem(List=len, Index=0, Wrap=True)
subtraction = Subtraction(A=item_13, B=division_4)
subtraction_2 = Subtraction(A=subtraction, B=division_4)

# ----
resulting_building_frontage_width_m = Panel(subtraction_2)

len_2 = Length(Curve=shatter_2)  # -> flatten(Length)
item_14 = ListItem(List=len_2, Index=0, Wrap=True)
subtraction_3 = Subtraction(A=item_14, B=division_3)
subtraction_4 = Subtraction(A=subtraction_3, B=division_3)

resulting_building_frontage_width_m_2 = Panel(subtraction_4)

panel_12 = Panel("ROAD")
panel_13 = Panel("SIDEWALK HEIGHT")
panel_14 = Panel("SIDEWALK")
loft_7 = Loft(
    Curves=[graft_3, graft],
    Options={Adjust=False, Closed=False, LoftEnds=0, LoftSimp=0, LoftType=0, Rebuild=10, Refit=0.01})
loft_8 = Loft(
    Curves=[offset_2, graft_2],
    Options={Adjust=False, Closed=False, LoftEnds=0, LoftSimp=0, LoftType=0, Rebuild=10, Refit=0.01})
loft_9 = Loft(Curves=offset, Options={Adjust=False, Closed=False, LoftEnds=0, LoftSimp=0, LoftType=0, Rebuild=10, Refit=0.01})

# ----
# Right of Way Surface
offset_5 = OffsetCurve(Curve=move.Geometry, Distance=[neg_2, ma_2.Result], Plane=PlaneXY(0, 0, 0), Corners=1)  # -> flatten(Curve)
loft_10 = Loft(Curves=offset_5, Options={Adjust=False, Closed=False, LoftEnds=0, LoftSimp=0, LoftType=0, Rebuild=10, Refit=0.01})

preview = CustomPreview(Geometry=[loft_8, loft_7], Material=ColourSwatch(SwatchColor=RGB(212, 212, 212)))
preview_2 = CustomPreview(Geometry=loft_9, Material=ColourSwatch(SwatchColor=RGB(76, 76, 76)))

debrep_11 = DeconstructBrep(Brep=loft_8)  # -> Faces, Edges, Vertices
preview_3 = CustomPreview(Geometry=debrep_11.Edges, Material=ColourSwatch(SwatchColor=RGB(0, 0, 0)))

# ---- group: clean small surfaces
area = Area(Geometry=loft_8)  # -> Area, Centroid
larger = LargerThan(FirstNumber=area.Area, SecondNumber="100")  # -> LargerThan, OrEqualTo
cull = CullPattern(List=loft_8, CullPattern=larger.OrEqualTo)
toggle = BooleanToggle(True)
simplify = SimplifyTree(Tree=cull, Front=False)
clean = CleanTree(RemoveNulls=toggle, RemoveInvalid=toggle, RemoveEmpty=toggle, Tree=simplify)

# ----
brep_side_2_constructed = Brep([extr_2, extr, boxrec])
brep_side_1_constructed = Brep([extr_4, boxrec_2, extr_3])
filter_3 = StreamFilter(Gate=use_external_model, Stream0=brep_side_1_constructed, Stream1=brep_side_1_external_model)

# ---- group: Preview
preview_4 = CustomPreview(Geometry=filter_3, Material=ColourSwatch(SwatchColor=RGB(255, 255, 255)))

# ----
# Screenshot Properties
panel_15 = Panel("C:\ladybug\screenshots")
section = Slider(1, range=1..10)
option = Slider(1, range=1..10)

# ----
# Side 1 Trees
# First row
# Second row
tree_type_6 = ValueList({"Delonix regia [5 years]": 0, "Delonix regia [10 years]": 1, "Delonix regia [mature]": 2, "Celtis Bungea [5 years]": 3, "Celtis Bungea [10 years]": 4, "Celtis Bungea [mature]": 5, "Fraxinus Uhdei Var Obelisk [5 years]": 6, "Fraxinus Uhdei Var Obelisk [10 years]": 7, "Fraxinus Uhdei Var Obelisk [mature]": 8}, selected="Delonix regia [5 years]")
tree_trunk_setback_from_curb_m = Slider(1, range=0..50)
number_of_trees = Slider(32, range=0..60)
tree_trunk_setback_from_curb_m_2 = Slider(4.1, range=0..50)
number_of_trees_2 = Slider(16, range=0..60)
# Shading Elements Design
add_trees = LBFalseStartToggle(False)
add_trees_2 = LBFalseStartToggle(False)

tree_picker_2 = TreePicker(G=tree_type_3)  # -> f_l, R, Z, R_2
tree = Tree(F=tree_picker_2.f_l, R_2=tree_picker_2.R, L=tree_picker_2.f_l, Z=tree_picker_2.Z, R=tree_picker_2.R_2)  # -> graft(עלווה), tree_trunk, tree_base, canopy_cover_projection
filter_4 = StreamFilter(Gate=add_trees_2, Stream0="0", Stream1=tree.עלווה)
filter_5 = StreamFilter(Gate=add_trees_2, Stream0="0", Stream1=tree.canopy_cover_projection)
graft_8 = GraftTree(Tree=move.Geometry, IncludeEmptyLists=True, IncludeNullItems=True)
bang_3 = ExplodeTree(Data=graft_8)  # -> Branch0, Branch1
neg_11 = Negative(Value=tree_trunk_setback_from_curb_m_2)
X_12 = UnitX(Factor=neg_11)
move_26 = Move(Geometry=bang_3.Branch1, Motion=X_12)  # -> Geometry, Transform
divide_3 = DivideCurve(Curve=bang_3.Branch1, Count=number_of_trees_2, Kinks=False)  # -> Points, Tangents, Parameters
shatter_3 = Shatter(Curve=move_26.Geometry, Parameters=divide_3.Parameters)
midpt_3 = CurveMiddle(Curve=shatter_3)
movetoplane = MoveToPlane(Geometry=midpt_3, Plane=PlaneXY(0, 0, 0), Above=True, Below=True)  # -> Geometry, Transform
panel_16 = Panel("tree full geo")
orient = Orient(Geometry=filter_5, Source=tree.tree_base, Target=movetoplane.Geometry)  # -> flatten(Geometry), Transform
orient_2 = Orient(Geometry=filter_4, Source=tree.tree_base, Target=midpt_3)  # -> Geometry, Transform
preview_5 = CustomPreview(Geometry=orient_2.Geometry, Material=filter)
len_3 = Length(Curve=shatter_3)
split = SplitList(List=flatten(len_3), Index="1")  # -> ListA, ListB
panel_17 = Panel(split.ListA)
join_5 = TextJoin(Text=panel_17)

tree_picker_3 = TreePicker(G=tree_type_6)  # -> f_l, R, Z, R_2
tree_2 = Tree(F=tree_picker_3.f_l, R_2=tree_picker_3.R, L=tree_picker_3.f_l, Z=tree_picker_3.Z, R=tree_picker_3.R_2)  # -> graft(עלווה), tree_trunk, tree_base, canopy_cover_projection
filter_6 = StreamFilter(Gate=add_trees, Stream0="0", Stream1=tree_2.canopy_cover_projection)
filter_7 = StreamFilter(Gate=add_trees, Stream0="0", Stream1=tree_2.עלווה)
graft_9 = GraftTree(Tree=move.Geometry, IncludeEmptyLists=True, IncludeNullItems=True)
bang_4 = ExplodeTree(Data=graft_9)  # -> Branch0, Branch1
neg_12 = Negative(Value=tree_trunk_setback_from_curb_m)
X_13 = UnitX(Factor=neg_12)
move_27 = Move(Geometry=bang_4.Branch1, Motion=X_13)  # -> Geometry, Transform
divide_4 = DivideCurve(Curve=bang_4.Branch1, Count=number_of_trees, Kinks=False)  # -> Points, Tangents, Parameters
shatter_4 = Shatter(Curve=move_27.Geometry, Parameters=divide_4.Parameters)
midpt_4 = CurveMiddle(Curve=shatter_4)
movetoplane_2 = MoveToPlane(Geometry=midpt_4, Plane=PlaneXY(0, 0, 0), Above=True, Below=True)  # -> Geometry, Transform
orient_3 = Orient(Geometry=filter_7, Source=tree_2.tree_base, Target=midpt_4)  # -> Geometry, Transform
orient_4 = Orient(Geometry=filter_6, Source=tree_2.tree_base, Target=movetoplane_2.Geometry)  # -> flatten(Geometry), Transform
preview_6 = CustomPreview(Geometry=orient_3.Geometry, Material=filter)
len_4 = Length(Curve=shatter_4)
split_2 = SplitList(List=flatten(len_4), Index="1")  # -> ListA, ListB
panel_19 = Panel(split_2.ListA)
join_6 = TextJoin(Text=panel_19)

resulting_distance_between_tree_trunks_m = Panel(join_6)
resulting_distance_between_tree_trunks_m_2 = Panel(join_5)

# ----
# Boulevard Trees
# Second row
tree_trunk_setback_from_centerline_m = Slider(5, range=-10..10)
number_of_trees_3 = Slider(25, range=0..60)
tree_trunk_setback_from_centerline_m_2 = Slider(-5, range=-10..10)
number_of_trees_4 = Slider(25, range=0..60)
add_trees_3 = LBFalseStartToggle(False)
add_trees_4 = LBFalseStartToggle(False)

# ----
# Side 2 Trees
# First row
# Second row
tree_trunk_setback_from_curb_m_3 = Slider(1, range=0..50)
number_of_trees_5 = Slider(20, range=0..60)
tree_trunk_setback_from_curb_m_4 = Slider(4.3, range=0..50)
number_of_trees_6 = Slider(16, range=0..60)
add_trees_5 = LBFalseStartToggle(False)
add_trees_6 = LBFalseStartToggle(False)

# ----
# STREET CONFIGURATION
panel_20 = Panel("Part 1: street configuration")
ma_3 = MassAddition(Input=[traffic_strip_width_m, central_boulevard_width_m, parking_strip_width_side_1_m, parking_strip_width_side_2_m])  # -> Result, PartialResults
join_7 = TextJoin(Text=[ma_3.Result, " Meter"])
panel_21 = Panel(graft)
Z_8 = UnitZ(Factor=Slider(0.2, range=0..1))
panel_22 = Panel("SIDEWALK 2")
panel_23 = Panel("SIDEWALK 1")
Z_9 = UnitZ(Factor=Slider(0.1, range=0..0.1))
move_28 = Move(Geometry=debrep_11.Edges, Motion=Z_9)  # -> Geometry, Transform

resulting_road_width = Panel(join_7)

division_5 = Division(A=central_boulevard_width_m, B=2)
division_6 = Division(A=central_boulevard_width_m, B=2)
neg_13 = Negative(Value=division_6)
offset_6 = OffsetCurve(Curve=ln, Distance=[division_5, neg_13], Plane=PlaneXY(0, 0, 0), Corners=1)  # -> flatten(Curve)
loft_11 = Loft(Curves=offset_6, Options={Adjust=False, Closed=False, LoftEnds=0, LoftSimp=0, LoftType=0, Rebuild=10, Refit=0.01})
area_2 = Area(Geometry=loft_11)  # -> Area, Centroid
larger_2 = LargerThan(FirstNumber=area_2.Area, SecondNumber="100")  # -> LargerThan, OrEqualTo
panel_24 = Panel("Boulevard")
cull_2 = CullPattern(List=loft_11, CullPattern=larger_2.OrEqualTo)
toggle_2 = BooleanToggle(True)
simplify_2 = SimplifyTree(Tree=cull_2, Front=False)
clean_2 = CleanTree(RemoveNulls=toggle_2, RemoveInvalid=toggle_2, RemoveEmpty=toggle_2, Tree=simplify_2)
Z_10 = UnitZ(Factor=Slider(0.01, range=0..1))
move_29 = Move(Geometry=clean_2, Motion=Z_10)  # -> Geometry, Transform
preview_7 = CustomPreview(Geometry=move_29.Geometry, Material=ColourSwatch(SwatchColor=RGB(212, 212, 212)))

# ----
# TREE METRICS CALCULATION
panel_25 = Panel("0")
filter_8 = StreamFilter(Gate=add_trees_4, Stream0=panel_25, Stream1=number_of_trees_4)
filter_9 = StreamFilter(Gate=add_trees_6, Stream0="0", Stream1=number_of_trees_6)
filter_10 = StreamFilter(Gate=add_trees_3, Stream0="0", Stream1=number_of_trees_3)
filter_11 = StreamFilter(Gate=add_trees, Stream0="0", Stream1=number_of_trees)
filter_12 = StreamFilter(Gate=add_trees_5, Stream0="0", Stream1=number_of_trees_5)
filter_13 = StreamFilter(Gate=add_trees_2, Stream0="0", Stream1=number_of_trees_2)
addition_6 = Addition(A=filter_11, B=filter_13, C=filter_12, D=filter_9, E=filter_10, F=filter_8)
addition_7 = Addition(A=ma_3.Result, B=ma_2.Result, C=ma.Result)
multiplication_5 = Multiplication(A=street_length_m, B=addition_7)
total_number_of_trees = Panel(addition_6)
right_of_way_area = Panel(multiplication_5)
eval = Evaluate(F="Round((x/y)*1000,2)", x=total_number_of_trees, y=right_of_way_area)
trees_per_dunam = Panel(eval)

# ----
# Number of Trees
panel_26 = Panel("Number of Trees: ")
concat = Concatenate(FragmentC=panel_26, FragmentB=total_number_of_trees)
eval_2 = Evaluate(F="-(19*y-x)", x=y_coordinate, y=font_size)
pt_4 = ConstructPoint(XCoordinate=number_slider, YCoordinate=eval_2, ZCoordinate=0)
tag_3 = TextTag3D(Location=pt_4, Text=concat, Size=font_size, Colour="0,0,0", Justification=7)

# ----
# Tree Density
panel_27 = Panel("Trees per 1000 sqm: ")
concat_2 = Concatenate(FragmentC=panel_27, FragmentB=trees_per_dunam)
eval_3 = Evaluate(F="-(21*y-x)", x=y_coordinate, y=font_size)
pt_5 = ConstructPoint(XCoordinate=number_slider, YCoordinate=eval_3, ZCoordinate=0)
tag_4 = TextTag3D(Location=pt_5, Text=concat_2, Size=font_size, Colour="0,0,0", Justification=7)

# ----
# TREE AND AWNING CONFIGURATION
# SHADE AWNING
panel_28 = Panel("Part 3: shading configuration")
crv = Curve(bang_2.Branch1)
crv_2 = Curve(bang_2.Branch0)
panel_29 = Panel("כל העצים")

# ----
# SHADE AWNING
Z_11 = UnitZ(Factor=height_from_ground_m_2)
X_14 = UnitX(Factor=depth_2)
neg_14 = Negative(Value=X_14)
panel_30 = Panel(neg_14)
graft_10 = GraftTree(Tree=panel_30, IncludeEmptyLists=True, IncludeNullItems=True)
move_30 = Move(Geometry=crv_2, Motion=Z_11)  # -> Geometry, Transform
extr_5 = Extrude(Base=move_30.Geometry, Direction=graft_10)
preview_8 = CustomPreview(Geometry=extr_5, Material=ColourSwatch(SwatchColor=RGB(104, 150, 92)))

Z_12 = UnitZ(Factor=height_from_ground_m)
X_15 = UnitX(Factor=depth)
panel_31 = Panel(X_15)
move_31 = Move(Geometry=crv, Motion=Z_12)  # -> Geometry, Transform
graft_11 = GraftTree(Tree=panel_31, IncludeEmptyLists=True, IncludeNullItems=True)
extr_6 = Extrude(Base=move_31.Geometry, Direction=graft_11)
preview_9 = CustomPreview(Geometry=extr_6, Material=ColourSwatch(SwatchColor=RGB(104, 150, 92)))

# ----
# BUILDING CONFIGURATION
# Side 1 (constructed)
# Side 2 (constructed)
# Side 1 (external model)
# Side 2 (external model)
panel_32 = Panel("Part 2: building configuration")
panel_33 = Panel("Analysis Buildings")

# ----
# HOURLY SOLAR CALCULATIONS
expression_2 = Expression(x=start_hour, y=end_hour, Expression="y-x+1")
series = Series(Start=start_hour, Step=1, Count=expression_2)
panel_34 = Panel(series)
hoy = LBCalculateHOY(month=start_month_number, day=start_date_number, hour=series)  # -> flatten(hoy), flatten(doy), flatten(date); plug-in component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

# ----
# DAILY SOLAR CALCULATIONS
# Street radiation analysis
# Geometry vs. Context: Geometry: the surfaces on which the radiation analysis will be performed
# Context: all other surrounding buildings and objects that may cast shadows on the examined surfaces
# Defined sky matrix
# Sky dome
# Define anaysis period
panel_35 = Panel("http://climate.onebuilding.org/WMO_Region_6_Europe/ISR_Israel/TA_Tel-Aviv/ISR_TA_Tel.Aviv-Bet.Dagan.401790_TMYx.zip")
falsestart = LBFalseStartToggle(False)
downloadepw = LBDownloadWeather(weather_URL=panel_35)  # -> epw_file, stat_file, ddy_file; plug-in component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
epwmap = LBEPWmap(epw_map=falsestart)  # -> report; plug-in component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
importloc = LBImportLocation(epw_file=downloadepw.epw_file)  # -> location; plug-in component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
importepw = LBImportEPW(epw_file=downloadepw.epw_file)  # -> location, dry_bulb_temperature, dew_point_temperature, relative_humidity, wind_speed, wind_direction, direct_normal_rad, diffuse_horizontal_rad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; plug-in component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
analysisperiod = LBAnalysisPeriod(
    start_month=start_month_number,
    start_day=start_date_number,
    start_hour=start_hour,
    end_month=end_month_number,
    end_day=end_date_number,
    end_hour=end_hour)  # -> period, hoys, dates; plug-in component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
panel_36 = Panel(importloc)
panel_37 = Panel("C:\ladybug\SkyMatrixNEW")
number_slider_3 = Slider(0.18, range=0..1)
toggle_3 = BooleanToggle(True)
panel_38 = Panel("Courier")
skymatrix = LBCumulativeSkyMatrix(
    north=street_orientation_deg,
    location=importepw.location,
    direct_rad=importepw.direct_normal_rad,
    diffuse_rad=importepw.diffuse_horizontal_rad,
    hoys=analysisperiod.hoys,
    high_density=toggle_3,
    ground_ref=number_slider_3,
    folder=panel_37)  # -> report, sky_mtx; plug-in component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
skydome = LBSkyDome(sky_mtx=skymatrix.sky_mtx, center_pt="-170,80", scale=Slider(0.63, range=0..1))  # -> report, mesh, compass, legend, title, patch_vecs, patch_values, mesh_values, vis_set; plug-in component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
legendpar = LBLegendParameters(
    min="0",
    vert_or_horiz=Toggle(False),
    base_plane="100,-75",
    seg_height="15",
    seg_width="20",
    text_height=Slider(4, range=0..10))  # -> leg_par; plug-in component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
panel_39 = Panel(legendpar)
Z_13 = UnitZ(Factor=Slider(0.05, range=0..1))
neg_15 = Negative(Value=Z_13)

# ----
# INCOMING SOLAR RADIATION
toggle_4 = BooleanToggle(True)
legendpar_2 = LBLegendParameters(seg_count="10", num_decimals="0", vert_or_horiz=toggle_4, seg_height=Slider(14, range=0..30))  # -> leg_par; plug-in component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
number_slider_4 = Slider(-290, range=-500..1000)
number_slider_5 = Slider(10, range=0..100)
number_slider_6 = Slider(10, range=0..100)
applyper = LBApplyAnalysisPeriod(data=importepw.direct_normal_rad, period=analysisperiod.period)  # -> data; plug-in component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
pt_6 = ConstructPoint(XCoordinate=number_slider_4, YCoordinate=number_slider_5, ZCoordinate=0)
hourlyplot = LBHourlyPlot(data=applyper, base_pt=pt_6, x_dim=number_slider_6, y_dim=number_slider_6, legend_par=legendpar_2)  # -> report, mesh, legend, borders, labels, title, vis_set; plug-in component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
addition_8 = Addition(A=number_slider_4, B=Slider(-4, range=-15..0))
addition_9 = Addition(A=number_slider_5, B=Slider(31, range=0..100))
preview_10 = CustomPreview(
    Geometry=[hourlyplot.mesh, hourlyplot.legend],
    Material={diffuse=RGB(221, 160, 221), emission=RGB(66, 48, 66), shine=0.5, specular=RGB(255, 255, 255), transparency=0})
panel_40 = Panel(hourlyplot.labels)
pt_7 = ConstructPoint(XCoordinate=addition_8, YCoordinate=addition_9, ZCoordinate=0)
rad = Radians(Degrees="90")
prot = RotatePlane(Plane=pt_7, Angle=rad)
item_15 = ListItem(List=panel_40, Index="0", Wrap=True)
panel_41 = Panel("""Direct incoming
solar radiation 
by hour""")
tag_5 = TextTag3D(Location=prot, Text=item_15, Size="4", Colour="0,0,0", Justification=7)
addition_10 = Addition(A=number_slider_5, B=Slider(-14, range=-100..200))
addition_11 = Addition(A=number_slider_4, B=Slider(-15, range=-15..0))
pt_8 = ConstructPoint(XCoordinate=addition_11, YCoordinate=addition_10, ZCoordinate=0)
tag_6 = TextTag3D(Location=pt_8, Text=panel_41, Size="5", Colour="0,0,0", Justification=7)

bbox_2 = BoundingBox(Content=building_geometry_side_2_from_external_m, Plane=PlaneXY(0, 0, 0))  # -> Box, Box_2
sidewalk_2_boundary = Line(bang_2.Branch0)
X_16 = UnitX(Factor=front_building_line_m_4)

box_corners_2 = BoxCorners(Box=bbox_2.Box_2)  # -> CornerA, CornerB, CornerC, CornerD, CornerE, CornerF, CornerG, CornerH
ln_11 = Line(StartPoint=box_corners_2.CornerA, EndPoint=box_corners_2.CornerD)
midpt_5 = CurveMiddle(Curve=sidewalk_2_boundary)
midpt_6 = CurveMiddle(Curve=ln_11)

panel_42 = Panel(midpt_5)
vec2pt_2 = Vector2Pt(PointA=midpt_6, PointB=panel_42, Unitize=False)  # -> Vector, Length
move_32 = Move(Geometry=building_geometry_side_2_from_external_m, Motion=vec2pt_2.Vector)  # -> Geometry, Transform
move_33 = Move(Geometry=move_32.Geometry, Motion=X_16)  # -> Geometry, Transform
brep_side_2_external_model = Brep(move_33.Geometry)

filter_14 = StreamFilter(Gate=use_external_model_2, Stream0=brep_side_2_constructed, Stream1=brep_side_2_external_model)

# ---- group: Preview
preview_11 = CustomPreview(Geometry=filter_14, Material=ColourSwatch(SwatchColor=RGB(255, 255, 255)))

# ----
brep = Brep([filter_3, filter_14])

tree_picker_4 = TreePicker(G=tree_type_5)  # -> f_l, R, Z, R_2
tree_3 = Tree(F=tree_picker_4.f_l, R_2=tree_picker_4.R, L=tree_picker_4.f_l, Z=tree_picker_4.Z, R=tree_picker_4.R_2)  # -> graft(עלווה), tree_trunk, tree_base, canopy_cover_projection
graft_12 = GraftTree(Tree=move.Geometry, IncludeEmptyLists=True, IncludeNullItems=True)
bang_5 = ExplodeTree(Data=graft_12)  # -> Branch0, Branch1
X_17 = UnitX(Factor=tree_trunk_setback_from_curb_m_4)
move_34 = Move(Geometry=bang_5.Branch0, Motion=X_17)  # -> Geometry, Transform
divide_5 = DivideCurve(Curve=move_34.Geometry, Count=number_of_trees_6, Kinks=False)  # -> Points, Tangents, Parameters
shatter_5 = Shatter(Curve=move_34.Geometry, Parameters=divide_5.Parameters)
midpt_7 = CurveMiddle(Curve=shatter_5)
len_5 = Length(Curve=shatter_5)
split_3 = SplitList(List=flatten(len_5), Index="1")  # -> ListA, ListB
panel_44 = Panel(split_3.ListA)
join_8 = TextJoin(Text=panel_44)

resulting_distance_between_tree_trunks_m_3 = Panel(join_8)

tree_picker_5 = TreePicker(G=tree_type_2)  # -> f_l, R, Z, R_2
tree_4 = Tree(F=tree_picker_5.f_l, R_2=tree_picker_5.R, L=tree_picker_5.f_l, Z=tree_picker_5.Z, R=tree_picker_5.R_2)  # -> graft(עלווה), tree_trunk, tree_base, canopy_cover_projection
graft_13 = GraftTree(Tree=ln, IncludeEmptyLists=True, IncludeNullItems=True)
bang_6 = ExplodeTree(Data=graft_13)  # -> Branch0, Branch1
X_18 = UnitX(Factor=tree_trunk_setback_from_centerline_m)
move_35 = Move(Geometry=bang_6.Branch0, Motion=X_18)  # -> Geometry, Transform
divide_6 = DivideCurve(Curve=bang_6.Branch0, Count=number_of_trees_3, Kinks=False)  # -> Points, Tangents, Parameters
shatter_6 = Shatter(Curve=move_35.Geometry, Parameters=divide_6.Parameters)
midpt_8 = CurveMiddle(Curve=shatter_6)
len_6 = Length(Curve=shatter_6)
split_4 = SplitList(List=flatten(len_6), Index="1")  # -> ListA, ListB
panel_46 = Panel(split_4.ListA)
join_9 = TextJoin(Text=panel_46)

resulting_distance_between_tree_trunks_m_4 = Panel(join_9)

tree_picker_6 = TreePicker(G=tree_type)  # -> f_l, R, Z, R_2
tree_5 = Tree(F=tree_picker_6.f_l, R_2=tree_picker_6.R, L=tree_picker_6.f_l, Z=tree_picker_6.Z, R=tree_picker_6.R_2)  # -> graft(עלווה), tree_trunk, tree_base, canopy_cover_projection
graft_14 = GraftTree(Tree=ln, IncludeEmptyLists=True, IncludeNullItems=True)
bang_7 = ExplodeTree(Data=graft_14)  # -> Branch0, Branch1
X_19 = UnitX(Factor=tree_trunk_setback_from_centerline_m_2)
move_36 = Move(Geometry=bang_7.Branch0, Motion=X_19)  # -> Geometry, Transform
divide_7 = DivideCurve(Curve=bang_7.Branch0, Count=number_of_trees_4, Kinks=False)  # -> Points, Tangents, Parameters
shatter_7 = Shatter(Curve=move_36.Geometry, Parameters=divide_7.Parameters)
midpt_9 = CurveMiddle(Curve=shatter_7)
len_7 = Length(Curve=shatter_7)
split_5 = SplitList(List=flatten(len_7), Index="1")  # -> ListA, ListB
panel_48 = Panel(split_5.ListA)
join_10 = TextJoin(Text=panel_48)

resulting_distance_between_tree_trunks_m_5 = Panel(join_10)

tree_picker_7 = TreePicker(G=tree_type_4)  # -> f_l, R, Z, R_2
tree_6 = Tree(F=tree_picker_7.f_l, R_2=tree_picker_7.R, L=tree_picker_7.f_l, Z=tree_picker_7.Z, R=tree_picker_7.R_2)  # -> graft(עלווה), tree_trunk, tree_base, canopy_cover_projection
graft_15 = GraftTree(Tree=move.Geometry, IncludeEmptyLists=True, IncludeNullItems=True)
bang_8 = ExplodeTree(Data=graft_15)  # -> Branch0, Branch1
X_20 = UnitX(Factor=tree_trunk_setback_from_curb_m_3)
move_37 = Move(Geometry=bang_8.Branch0, Motion=X_20)  # -> Geometry, Transform
divide_8 = DivideCurve(Curve=move_37.Geometry, Count=number_of_trees_5, Kinks=False)  # -> Points, Tangents, Parameters
shatter_8 = Shatter(Curve=move_37.Geometry, Parameters=divide_8.Parameters)
midpt_10 = CurveMiddle(Curve=shatter_8)
len_8 = Length(Curve=shatter_8)
split_6 = SplitList(List=flatten(len_8), Index="1")  # -> ListA, ListB
panel_50 = Panel(split_6.ListA)
join_11 = TextJoin(Text=panel_50)

resulting_distance_between_tree_trunks_m_6 = Panel(join_11)

# ----
# SECTION VIEW PROPERTIES
number_slider_7 = Slider(2, range=0..10)
neg_16 = Negative(Value=number_slider_7)
multiplication_6 = Multiplication(B=neg_16)
Y_9 = UnitY(Factor=multiplication_6)
item_16 = ListItem(List=debrep_2.Faces, Index=Slider(6, range=0..10), Wrap=True)  # -> flatten(Item)
number_slider_8 = Slider(177, range=0..1000)
item_17 = ListItem(List=item_16, Index=section_number, Wrap=True)
number_slider_9 = Slider(-486, range=-1000..1000)
move_38 = Move(Geometry=item_17, Motion=Y_9)  # -> Geometry, Transform
X_21 = UnitX(Factor=number_slider_8)
planesrf_2 = PlaneSurface(Plane=move_38.Geometry, XSize=number_slider_9, YSize=number_slider_9)
neg_17 = Negative(Value=number_slider_8)
panel_51 = Panel("SECTION")
move_39 = Move(Geometry=planesrf_2, Motion=X_21)  # -> Geometry, Transform
Z_14 = UnitZ(Factor=neg_17)
move_40 = Move(Geometry=move_39.Geometry, Motion=Z_14)  # -> Geometry, Transform
neg_18 = Negative(Value=Slider(279, range=0..1000))
X_22 = UnitX(Factor=neg_18)

filter_15 = StreamFilter(Gate=add_trees_3, Stream0="0", Stream1=tree_4.עלווה)
filter_16 = StreamFilter(Gate=add_trees_5, Stream0="0", Stream1=tree_6.עלווה)
filter_17 = StreamFilter(Gate=add_trees_4, Stream0="0", Stream1=tree_5.עלווה)
filter_18 = StreamFilter(Gate=add_trees_3, Stream0="0", Stream1=tree_4.canopy_cover_projection)
filter_19 = StreamFilter(Gate=add_trees_5, Stream0="0", Stream1=tree_6.canopy_cover_projection)
filter_20 = StreamFilter(Gate=add_trees_4, Stream0="0", Stream1=tree_5.canopy_cover_projection)
filter_21 = StreamFilter(Gate=add_trees_6, Stream0="0", Stream1=tree_3.canopy_cover_projection)
filter_22 = StreamFilter(Gate=add_trees_6, Stream0="0", Stream1=tree_3.עלווה)
movetoplane_3 = MoveToPlane(Geometry=midpt_7, Plane=PlaneXY(0, 0, 0), Above=True, Below=True)  # -> Geometry, Transform
movetoplane_4 = MoveToPlane(Geometry=midpt_8, Plane=PlaneXY(0, 0, 0), Above=True, Below=True)  # -> Geometry, Transform
movetoplane_5 = MoveToPlane(Geometry=midpt_9, Plane=PlaneXY(0, 0, 0), Above=True, Below=True)  # -> Geometry, Transform
movetoplane_6 = MoveToPlane(Geometry=midpt_10, Plane=PlaneXY(0, 0, 0), Above=True, Below=True)  # -> Geometry, Transform
orient_5 = Orient(Geometry=filter_19, Source=tree_6.tree_base, Target=movetoplane_6.Geometry)  # -> flatten(Geometry), Transform
orient_6 = Orient(Geometry=filter_20, Source=tree_5.tree_base, Target=movetoplane_5.Geometry)  # -> flatten(Geometry), Transform
orient_7 = Orient(Geometry=filter_21, Source=tree_3.tree_base, Target=movetoplane_3.Geometry)  # -> flatten(Geometry), Transform
orient_8 = Orient(Geometry=filter_18, Source=tree_4.tree_base, Target=movetoplane_4.Geometry)  # -> flatten(Geometry), Transform

orient_9 = Orient(Geometry=filter_22, Source=tree_3.tree_base, Target=midpt_7)  # -> Geometry, Transform
preview_12 = CustomPreview(Geometry=orient_9.Geometry, Material=filter)

orient_10 = Orient(Geometry=filter_16, Source=tree_6.tree_base, Target=midpt_10)  # -> Geometry, Transform
preview_13 = CustomPreview(Geometry=orient_10.Geometry, Material=filter)

orient_11 = Orient(Geometry=filter_15, Source=tree_4.tree_base, Target=midpt_8)  # -> Geometry, Transform
preview_14 = CustomPreview(Geometry=orient_11.Geometry, Material=filter)

orient_12 = Orient(Geometry=filter_17, Source=tree_5.tree_base, Target=midpt_9)  # -> Geometry, Transform
preview_15 = CustomPreview(Geometry=orient_12.Geometry, Material=filter)

# ----
# Tree Canopy Cover Calculation
pt_9 = Point(Point(0, 0, 0.5))
runion = RegionUnion(
    Curves=[orient_4.Geometry, orient.Geometry, orient_5.Geometry, orient_7.Geometry, orient_8.Geometry, orient_6.Geometry],
    Plane=pt_9)
movetoplane_7 = MoveToPlane(Geometry=loft_10, Plane=PlaneXY(0, 0, 0), Above=True, Below=True)  # -> Geometry, Transform
runion_2 = RegionUnion(Curves=[orient_4.Geometry, orient.Geometry, orient_5.Geometry, orient_7.Geometry, orient_8.Geometry, orient_6.Geometry])
filter_23 = StreamFilter(Gate=true_on, Stream0=ColourSwatch(SwatchColor=RGBA(0, 0, 0, 0)))
rint = RegionIntersection(CurvesA=runion_2, CurvesB=movetoplane_7.Geometry)  # -> flatten(Result)
preview_16 = CustomPreview(Geometry=runion, Material=filter_23)
boundary = BoundarySurfaces(Edges=rint)
area_3 = Area(Geometry=movetoplane_7.Geometry)  # -> Area, Centroid
area_4 = Area(Geometry=boundary)  # -> Area, Centroid
panel_52 = Panel(area_4.Area)
ma_4 = MassAddition(Input=area_4.Area)  # -> Result, PartialResults
expression_3 = Expression(x=ma_4.Result, y=area_3.Area, Expression="Round(x/y,2)")
tree_canopy_cover = Panel(expression_3)

brep_2 = Brep([orient_10.Geometry, orient_9.Geometry, orient_3.Geometry, orient_2.Geometry, orient_11.Geometry, extr_5, extr_6, orient_6.Geometry, orient_12.Geometry])

relay = Relay([brep_2, brep])

brep_3 = Brep([relay, brep_2, loft_9, loft_7, loft_8])
bbx = BrepBrep(BrepA=move_40.Geometry, BrepB=brep_3)  # -> Curves, Points
move_41 = Move(Geometry=bbx.Curves, Motion=X_22)  # -> Geometry, Transform
boundary_2 = BoundarySurfaces(Edges=move_41.Geometry)
preview_17 = CustomPreview(Geometry=[move_41.Geometry, bbx.Curves, boundary_2], Material=ColourSwatch(SwatchColor=RGB(0, 0, 0)))

bang_9 = ExplodeTree(Data=clean)  # -> Branch0, Branch1
flip_6 = Flip(Surface=bang_9.Branch1)  # -> Surface, Result
brep_4 = Brep(relay)
shaded_surfaces = Brep([bang_9.Branch0, flip_6.Surface, loft_9])
context_shading = Brep(brep_4)

# ---- group: 4. Define analysis geometries
brep_5 = Brep(flatten(context_shading))
brep_6 = Brep(shaded_surfaces)

# ----
null = NullItem(Item=brep_5)  # -> NullFlags, InvalidFlags, Description
dispatch = Dispatch(List=brep_5, DispatchPattern=null.NullFlags)  # -> ListA, ListB
sunion = SolidUnion(Breps=brep_6)

incidentradiation = LBIncidentRadiation(
    sky_mtx=skymatrix.sky_mtx,
    geometry=flatten([sunion, planesrf]),
    context=flatten(dispatch.ListB),
    grid_size=panel_4,
    offset_dist="0.1",
    legend_par=legendpar,
    run=true_turn_analysis_on)  # -> report, points, results, total, mesh, legend, title, int_mtx; plug-in component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
panel_53 = Panel(incidentradiation.title)
move_42 = Move(Geometry=incidentradiation.mesh, Motion=[Z_13, neg_15])  # -> Geometry, Transform

skymatrix_2 = LBCumulativeSkyMatrix(
    north=street_orientation_deg,
    location=importepw.location,
    direct_rad=importepw.direct_normal_rad,
    diffuse_rad=importepw.diffuse_horizontal_rad,
    hoys=graft(hoy.hoy),
    high_density=toggle_3,
    ground_ref=number_slider_3,
    folder=panel_37)  # -> report, sky_mtx; plug-in component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
rtrad = LBRealTimeIncidentRadiation(int_mtx=incidentradiation.int_mtx, sky_mtx=skymatrix_2.sky_mtx)  # -> results; plug-in component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
viewer = ParamViewer(rtrad)
panel_54 = Panel(rtrad)

# ----
# Results division according to strip type
# hourly for shade availability analysis
pdecon = Deconstruct(Point=incidentradiation.points)  # -> XComponent, YComponent, ZComponent
pdecon_2 = Deconstruct(Point=pt)  # -> XComponent, YComponent, ZComponent
pdecon_3 = Deconstruct(Point=incidentradiation.points)  # -> XComponent, YComponent, ZComponent
pdecon_4 = Deconstruct(Point=incidentradiation.points)  # -> XComponent, YComponent, ZComponent
pdecon_5 = Deconstruct(Point=incidentradiation.points)  # -> XComponent, YComponent, ZComponent
eval_4 = Evaluate(F="(x≥(½*y))AND(x≤(Z+½*y))", x=pdecon.XComponent, y=ma_3.Result, z=ma.Result)
eval_5 = Evaluate(F="(x≥-(z+½*y))AND(x≤-(½*y))", x=pdecon_4.XComponent, y=ma_3.Result, z=ma_2.Result)
eval_6 = Evaluate(F="(x≥-(½*z))AND(x≤(½*z))", x=pdecon_5.XComponent, z=central_boulevard_width_m)
eval_7 = Evaluate(F="x-(z/2)=y", x=pdecon_3.YComponent, y=pdecon_2.YComponent, z=analysis_resolution)
cull_3 = CullPattern(List=rtrad, CullPattern=eval_5)
cull_4 = CullPattern(List=rtrad, CullPattern=eval_7)
cull_5 = CullPattern(List=rtrad, CullPattern=eval_4)
cull_6 = CullPattern(List=rtrad, CullPattern=eval_6)
reference_point_result = Panel(cull_4)
boulevard_results = Panel(cull_6)
sidewalk_1_results = Panel(cull_3)
sidewalk_2_results = Panel(cull_5)

# ----
# Results division according to strip type
pdecon_6 = Deconstruct(Point=pt)  # -> XComponent, YComponent, ZComponent
pdecon_7 = Deconstruct(Point=incidentradiation.points)  # -> XComponent, YComponent, ZComponent
pdecon_8 = Deconstruct(Point=incidentradiation.points)  # -> XComponent, YComponent, ZComponent
pdecon_9 = Deconstruct(Point=incidentradiation.points)  # -> XComponent, YComponent, ZComponent
pdecon_10 = Deconstruct(Point=incidentradiation.points)  # -> XComponent, YComponent, ZComponent
pdecon_11 = Deconstruct(Point=incidentradiation.points)  # -> XComponent, YComponent, ZComponent
pdecon_12 = Deconstruct(Point=incidentradiation.points)  # -> XComponent, YComponent, ZComponent
# SAI threshold
pdecon_13 = Deconstruct(Point=pt)  # -> XComponent, YComponent, ZComponent
eval_8 = Evaluate(F="(x≥-(z+½*y))AND(x≤-(½*y))", x=pdecon_9.XComponent, y=ma_3.Result, z=ma_2.Result)
eval_9 = Evaluate(
    F="((x≥-(½*y))AND(x≤-(½*z)))OR((x≥(½*z))AND(x≤(½*y)))",
    x=pdecon_7.XComponent,
    y=ma_3.Result,
    z=central_boulevard_width_m)
eval_10 = Evaluate(F="x-(z/2)=y", x=pdecon_8.YComponent, y=pdecon_6.YComponent, z=analysis_resolution)
eval_11 = Evaluate(F="(x≥(½*y))AND(x≤(Z+½*y))", x=pdecon_10.XComponent, y=ma_3.Result, z=ma.Result)
eval_12 = Evaluate(F="(x≥-(½*z))AND(x≤(½*z))", x=pdecon_11.XComponent, z=central_boulevard_width_m)
eval_13 = Evaluate(F="x-(z/2)≠y", x=pdecon_12.YComponent, y=pdecon_13.YComponent, z=analysis_resolution)
cull_7 = CullPattern(List=incidentradiation.results, CullPattern=eval_8)
cull_8 = CullPattern(List=incidentradiation.results, CullPattern=eval_10)
cull_9 = CullPattern(List=incidentradiation.results, CullPattern=eval_11)
cull_10 = CullPattern(List=incidentradiation.results, CullPattern=eval_13)
cull_11 = CullPattern(List=incidentradiation.results, CullPattern=eval_9)
cull_12 = CullPattern(List=incidentradiation.results, CullPattern=eval_12)
road_results = Panel(cull_11)
reference_point_result_2 = Panel(cull_8)
sidewalk_1_results_2 = Panel(cull_7)
sidewalk_2_results_2 = Panel(cull_9)
boulevard_results_2 = Panel(cull_12)
right_of_way_results = Panel(cull_10)

panel_55 = Panel(incidentradiation.results)
ma_5 = MassAddition(Input=panel_55)  # -> Result, PartialResults
rep = ReplaceText(Text=ma_5.Result, Find=".", RecursiveReplace=False)

concat_3 = Concatenate(FragmentA="Sec", FragmentB=section, FragmentC=" Opt ", FragmentD=option, FragmentE="_", FragmentF=rep)
panel_56 = Panel(concat_3)
captureview = LBCaptureView(file_name=panel_56, folder=panel_15, viewport="Shade_Analysis", capture=true_turn_analysis_on)  # -> file; plug-in component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

shade_availability_calculation = ShadeAvailabilityCalculation(x=cull_6, y=cull_4, z=hourly_target_shade_availability_ratio)  # -> R, r, R_2, L
shade_availability_calculation_2 = ShadeAvailabilityCalculation(x=cull_3, y=cull_4, z=hourly_target_shade_availability_ratio)  # -> R, r, R_2, L
shade_availability_calculation_3 = ShadeAvailabilityCalculation(x=cull_5, y=cull_4, z=hourly_target_shade_availability_ratio)  # -> R, r, R_2, L
daily_shade_availability_index = Panel(shade_availability_calculation.R_2)
daily_shade_availability_index_2 = Panel(shade_availability_calculation_3.R_2)
expression_4 = Expression(x=shade_availability_calculation_2.R_2, Expression="Round(x,2)")
expression_5 = Expression(x=shade_availability_calculation.R_2, Expression="Round(x,2)")
daily_shade_availability_index_3 = Panel(shade_availability_calculation_2.R_2)
expression_6 = Expression(x=shade_availability_calculation_3.R_2, Expression="Round(x,2)")

# ----
# Boulevard Resulting Shade Index
# Max solar irradiance in street
# Max theoretical solar irradiance
division_7 = Division(A=boulevard_results_2, B=reference_point_result_2)
sort = SortList(Keys=sidewalk_2_results_2)  # -> Keys, ValuesA
subtraction_5 = Subtraction(A="1", B=division_7)
rev = ReverseList(List=sort.Keys)
avr = Average(Input=subtraction_5)
item_18 = ListItem(List=rev, Index="0", Wrap=True)
expression_7 = Expression(x=avr, Expression="Round(x,2)")
panel_57 = Panel(reference_point_result_2)
panel_58 = Panel(item_18)
concat_4 = Concatenate(FragmentC="Boulevard ", FragmentA="Shade Index: ", FragmentB=expression_7)
eval_14 = Evaluate(F="-(9*y-x)", x=y_coordinate, y=font_size)
panel_59 = Panel(expression_7)
pt_10 = ConstructPoint(XCoordinate=number_slider, YCoordinate=eval_14, ZCoordinate=0)
tag_7 = TextTag3D(Location=pt_10, Text=concat_4, Size=filter_2, Colour="0,0,0", Justification=7)

# ----
# Sidewalks 2 Resulting Shade Index
# Max solar irradiance in street
# Max theoretical solar irradiance
division_8 = Division(A=sidewalk_2_results_2, B=reference_point_result_2)
sort_2 = SortList(Keys=sidewalk_2_results_2)  # -> Keys, ValuesA
subtraction_6 = Subtraction(A="1", B=division_8)
rev_2 = ReverseList(List=sort_2.Keys)
avr_2 = Average(Input=subtraction_6)
item_19 = ListItem(List=rev_2, Index="0", Wrap=True)
expression_8 = Expression(x=avr_2, Expression="Round(x,2)")
panel_61 = Panel(item_19)
eval_15 = Evaluate(F="-(7*y-x)", x=y_coordinate, y=font_size)
concat_5 = Concatenate(FragmentC="Sidewalk 2 ", FragmentA="Shade Index: ", FragmentB=expression_8)
panel_62 = Panel(expression_8)
panel_63 = Panel("10")
pt_11 = ConstructPoint(XCoordinate=number_slider, YCoordinate=eval_15, ZCoordinate=0)
tag_8 = TextTag3D(Location=pt_11, Text=concat_5, Size=font_size, Colour="0,0,0", Justification=7)

# ----
# Tree Canopy Cover
null_2 = NullItem(Item=tree_canopy_cover)  # -> NullFlags, InvalidFlags, Description
filter_24 = StreamFilter(Gate=null_2.NullFlags, Stream0=tree_canopy_cover, Stream1="0")
concat_6 = Concatenate(FragmentC="Tree Canopy Cover: ", FragmentB=filter_24)
eval_16 = Evaluate(F="-(23*y-x)", x=y_coordinate, y=font_size)
pt_12 = ConstructPoint(XCoordinate=number_slider, YCoordinate=eval_16, ZCoordinate=0)
tag_9 = TextTag3D(Location=pt_12, Text=concat_6, Size=font_size, Colour="0,0,0", Justification=7)

# ----
# Road Resulting Shade Index
# Max solar irradiance in street
# Max theoretical solar irradiance
division_9 = Division(A=road_results, B=reference_point_result_2)
sort_3 = SortList(Keys=road_results)  # -> Keys, ValuesA
subtraction_7 = Subtraction(A="1", B=division_9)
rev_3 = ReverseList(List=sort_3.Keys)
avr_3 = Average(Input=subtraction_7)
item_20 = ListItem(List=rev_3, Index="0", Wrap=True)
expression_9 = Expression(x=avr_3, Expression="Round(x,2)")
panel_65 = Panel(item_20)
eval_17 = Evaluate(F="-(2*y-x)", x=y_coordinate, y=font_size)
concat_7 = Concatenate(FragmentD="Road ", FragmentA="Shade Index: ", FragmentB=expression_9)
panel_66 = Panel(expression_9)
pt_13 = ConstructPoint(XCoordinate=number_slider, YCoordinate=eval_17, ZCoordinate=0)
tag_10 = TextTag3D(Location=pt_13, Text=concat_7, Size=font_size, Colour="0,0,0", Justification=7)

# ----
# Sidewalks 1 Resulting Shade Index
# Max solar irradiance in street
# Max theoretical solar irradiance
division_10 = Division(A=sidewalk_1_results_2, B=reference_point_result_2)
sort_4 = SortList(Keys=sidewalk_1_results_2)  # -> Keys, ValuesA
subtraction_8 = Subtraction(A="1", B=division_10)
rev_4 = ReverseList(List=sort_4.Keys)
avr_4 = Average(Input=subtraction_8)
item_21 = ListItem(List=rev_4, Index="0", Wrap=True)
expression_10 = Expression(x=avr_4, Expression="Round(x,2)")
panel_69 = Panel(item_21)
concat_8 = Concatenate(FragmentC="Sidewalk 1 ", FragmentA="Shade Index: ", FragmentB=expression_10)
eval_18 = Evaluate(F="-(5*y-x)", x=y_coordinate, y=font_size)
panel_70 = Panel(expression_10)
pt_14 = ConstructPoint(XCoordinate=number_slider, YCoordinate=eval_18, ZCoordinate=0)
tag_11 = TextTag3D(Location=pt_14, Text=concat_8, Size=font_size, Colour="0,0,0", Justification=7)

# ----
# RESULTS DISPLAY GENERATION
# Right of Way Resulting Shade Index
# Max solar irradiance in street
# Max theoretical solar irradiance
division_11 = Division(A=right_of_way_results, B=reference_point_result_2)
sort_5 = SortList(Keys=right_of_way_results)  # -> Keys, ValuesA
subtraction_9 = Subtraction(A="1", B=division_11)
rev_5 = ReverseList(List=sort_5.Keys)
avr_5 = Average(Input=subtraction_9)
item_22 = ListItem(List=rev_5, Index="0", Wrap=True)
expression_11 = Expression(x=avr_5, Expression="Round(x,2)")
panel_73 = Panel(item_22)
concat_9 = Concatenate(FragmentC="Right of way ", FragmentA="Shade Index: ", FragmentB=expression_11)
pt_15 = ConstructPoint(XCoordinate=number_slider, YCoordinate=y_coordinate, ZCoordinate=0)
panel_74 = Panel(expression_11)
tag_12 = TextTag3D(Location=pt_15, Text=concat_9, Size=font_size, Colour="0,0,0", Justification=7)

# ----
# Boulevard Resulting Shade Availability Index
panel_76 = Panel("Shade Availability Index: ")
expression_12 = Expression(x=central_boulevard_width_m, Expression="x=0")
eval_19 = Evaluate(F="-(16*y-x)", x=y_coordinate, y=font_size)
filter_25 = StreamFilter(Gate=expression_12, Stream0=font_size, Stream1="0")
concat_10 = Concatenate(FragmentC="Boulevard ", FragmentA=panel_76, FragmentB=expression_5)
pt_16 = ConstructPoint(XCoordinate=number_slider, YCoordinate=eval_19, ZCoordinate=0)
tag_13 = TextTag3D(Location=pt_16, Text=concat_10, Size=filter_25, Colour="0,0,0", Justification=7)

# ----
# Sidewalks 2 Resulting Shade Availability Index
panel_77 = Panel("Shade Availability Index: ")
eval_20 = Evaluate(F="-(14*y-x)", x=y_coordinate, y=font_size)
concat_11 = Concatenate(FragmentC="Sidewalk 2 ", FragmentA=panel_77, FragmentB=expression_6)
pt_17 = ConstructPoint(XCoordinate=number_slider, YCoordinate=eval_20, ZCoordinate=0)
tag_14 = TextTag3D(Location=pt_17, Text=concat_11, Size=font_size, Colour="0,0,0", Justification=7)

# ----
# Sidewalks 1 Resulting Shade Availability Index
panel_78 = Panel("Shade Availability Index: ")
eval_21 = Evaluate(F="-(12*y-x)", x=y_coordinate, y=font_size)
concat_12 = Concatenate(FragmentC="Sidewalk 1 ", FragmentA=panel_78, FragmentB=expression_4)
pt_18 = ConstructPoint(XCoordinate=number_slider, YCoordinate=eval_21, ZCoordinate=0)
tag_15 = TextTag3D(Location=pt_18, Text=concat_12, Size=font_size, Colour="0,0,0", Justification=7)

debrep_12 = DeconstructBrep(Brep=move_29.Geometry)  # -> Faces, Edges, Vertices

move_43 = Move(Geometry=debrep_12.Edges, Motion=Z_8)  # -> Geometry, Transform

preview_18 = CustomPreview(Geometry=move_43.Geometry, Material=ColourSwatch(SwatchColor=RGB(0, 0, 0)))

# ==== cluster Tree
Z = ClusterInput()
R = ClusterInput()
F = ClusterInput()
R_2 = ClusterInput()
L = ClusterInput()
pt = ConstructPoint(XCoordinate=0, YCoordinate=0, ZCoordinate=Z)
pt_2 = ConstructPoint(XCoordinate=0, YCoordinate=0, ZCoordinate=0)
Z_2 = UnitZ(Factor=F)
panel = Panel(F)
ln = Line(StartPoint=pt, EndPoint=pt_2)
pt_3 = Point(Point(0, 0, 0))
cir = Circle(Plane=pt_3, Radius=R_2)
cyl = Cylinder(Base=pt, Radius=R_2, Length=L)
move = Move(Geometry=pt, Motion=Z_2)  # -> Geometry, Transform
pipe = Pipe(Curve=ln, Radius=R, Caps=0)
canopy_cover_projection = ClusterOutput(cir)
cap = CapHoles(Brep=cyl)
cap_2 = CapHoles(Brep=pipe)
tree_base = ClusterOutput(pt_2)
tree_trunk = ClusterOutput(pipe)
debrep = DeconstructBrep(Brep=cap)  # -> Faces, Edges, Vertices
multiplication = Multiplication(A=F, B=Slider(0.3, range=0..1))
Z_3 = UnitZ(Factor=multiplication)
move_2 = Move(Geometry=move.Geometry, Motion=Z_3)  # -> Geometry, Transform
item = ListItem(List=debrep.Edges, Index=2, Wrap=True)
extr = ExtrudePoint(Base=item, Point=move_2.Geometry)
cap_3 = CapHoles(Brep=extr)
sunion = SolidUnion(Breps=[cap_3, cap, cap_2])  # -> flatten(Result)
preview = CustomPreview(Geometry=sunion, Material=ColourSwatch(SwatchColor=RGB(104, 150, 92)))
עלווה = ClusterOutput(sunion)
preview_2 = CustomPreview(Geometry=pipe, Material=ColourSwatch(SwatchColor=RGB(0, 0, 0)))
panel_2 = Panel(sunion)

# ==== cluster ShadeAvailabilityCalculation
x = ClusterInput()
y = ClusterInput()
shaded_of_not = Evaluate(F="x≤0.6*y", x=x, y=y)
lng = ListLength(List=shaded_of_not)
ma = MassAddition(Input=shaded_of_not)  # -> Result, PartialResults
z = ClusterInput()
L = ClusterOutput(lng)
R = ClusterOutput(ma.Result)
eval = Evaluate(F="x/y≥z", x=ma.Result, y=lng, z=z)
r = ClusterOutput(eval)
ma_2 = MassAddition(Input=flatten(eval))  # -> Result, PartialResults
lng_2 = ListLength(List=flatten(eval))
division = Division(A=ma_2.Result, B=lng_2)
R_2 = ClusterOutput(division)

# ==== cluster TreePicker

# ----
# Fraxinus Uhdei Var Obelisk, מילה ירוקת עד [mature]
panel = Panel("גובה עלווה")
panel_2 = Panel("רדיוס עלווה")
panel_3 = Panel("רדיוס גזע")
panel_4 = Panel("גובה גזע")
canopy_height = Slider(11, range=1..15)
canopy_radius = Slider(2, range=1..15)
trunk_height = Slider(3, range=1..15)
trunk_radius = Slider(0.3, range=0.1..1.1)

# ----
# Change each slider to determine the tree configuration, when done press the box on the top left of the screen and "save & close"
# Delonix regia, צאלון נאה [5 years]
panel_5 = Panel("גובה עלווה")
canopy_height_2 = Slider(2.5, range=1..15)
canopy_radius_2 = Slider(2.5, range=1..15)
trunk_height_2 = Slider(4.5, range=1..15)
trunk_radius_2 = Slider(0.3, range=0.1..1.1)

# ----
# Delonix regia, צאלון נאה [10 years]
panel_12 = Panel("גובה עלווה")
canopy_radius_3 = Slider(4, range=1..15)
trunk_height_3 = Slider(4.5, range=1..15)
trunk_radius_3 = Slider(0.3, range=0.1..1.1)
canopy_height_3 = Slider(5, range=1..15)

# ----
# Delonix regia, צאלון נאה [mature]
panel_16 = Panel("גובה עלווה")
canopy_radius_4 = Slider(10, range=1..15)
trunk_height_4 = Slider(3, range=1..15)
trunk_radius_4 = Slider(0.3, range=0.1..1.1)
canopy_height_4 = Slider(9, range=1..15)

# ----
# Fraxinus Uhdei Var Obelisk, מילה ירוקת עד [10 years]
panel_17 = Panel("גובה עלווה")
canopy_height_5 = Slider(6, range=1..15)
canopy_radius_5 = Slider(2, range=1..15)
trunk_height_5 = Slider(3, range=1..15)
trunk_radius_5 = Slider(0.3, range=0.1..1.1)

# ----
# Celtis Bungea, מייש בונגה [5 years]
panel_21 = Panel("גובה עלווה")
# Celtis Bungea, מייש בונגה [10 years]
panel_24 = Panel("רדיוס גזע")
canopy_height_6 = Slider(3, range=1..15)
canopy_radius_6 = Slider(2, range=1..15)
trunk_height_6 = Slider(4.5, range=1..15)
trunk_radius_6 = Slider(0.3, range=0.1..1.1)

# ----
# Fraxinus Uhdei Var Obelisk, מילה ירוקת עד [5 years]
panel_25 = Panel("גובה עלווה")
canopy_height_7 = Slider(3, range=1..15)
canopy_radius_7 = Slider(1.5, range=1..15)
trunk_height_7 = Slider(3, range=1..15)
trunk_radius_7 = Slider(0.3, range=0.1..1.1)

panel_31 = Panel("גובה עלווה")
canopy_radius_8 = Slider(4, range=1..15)
trunk_height_8 = Slider(4.5, range=1..15)
canopy_height_8 = Slider(5, range=1..15)
trunk_radius_8 = Slider(0.3, range=0.1..1.1)

# ----
# Celtis Bungea, מייש בונגה [mature]
panel_33 = Panel("גובה עלווה")
canopy_height_9 = Slider(12, range=1..15)
canopy_radius_9 = Slider(5, range=1..15)
trunk_height_9 = Slider(3, range=1..15)
trunk_radius_9 = Slider(0.3, range=0.1..1.1)

G = ClusterInput()
filter = StreamFilter(
    Gate=G,
    Stream0=[canopy_height_2, canopy_radius_2, trunk_height_2, trunk_radius_2],
    Stream1=[canopy_height_3, canopy_radius_3, trunk_height_3, trunk_radius_3],
    Stream2=[canopy_height_4, canopy_radius_4, trunk_height_4, trunk_radius_4],
    Stream3=[canopy_height_6, canopy_radius_6, trunk_height_6, trunk_radius_6],
    Stream4=[canopy_height_8, canopy_radius_8, trunk_height_8, trunk_radius_8],
    Stream5=[canopy_height_9, canopy_radius_9, trunk_height_9, trunk_radius_9],
    Stream6=[canopy_height_7, canopy_radius_7, trunk_height_7, trunk_radius_7],
    Stream7=[canopy_height_5, canopy_radius_5, trunk_height_5, trunk_radius_5],
    Stream8=[canopy_height, canopy_radius, trunk_height, trunk_radius])  # -> graft(Stream)
bang = ExplodeTree(Data=filter)  # -> Branch0, Branch1, Branch2, Branch3
f_l = ClusterOutput(bang.Branch0)
R = ClusterOutput(bang.Branch1)
R_2 = ClusterOutput(bang.Branch3)
Z = ClusterOutput(bang.Branch2)
